# Grasshopper definition bracelet3.gh (Grasshopper 0.9.76)
# plug-ins: Agent

construct_point = ConstructPoint(XCoordinate=0, YCoordinate=0, ZCoordinate=0)
circle_cnr = CircleCNR(Center=construct_point, Normal=Vector(0, 0, 1), Radius=Slider(7, range=0..10))
evaluate_curve = EvaluateCurve(Curve=circle_cnr, Parameter=Slider(26, range=0..100))  # -> Point, Tangent, Angle
series = Series(Start=Slider(0.3, range=0..1), Step=Slider(0.2, range=0..1), Count=Slider(2, range=0..10))
series_2 = Series(Start=0, Step=Slider(0.1, range=0..0.1), Count=10)
circle_cnr_2 = CircleCNR(Center=evaluate_curve.Point, Normal=evaluate_curve.Tangent, Radius=series)
pipe_variable = PipeVariable(
    Curve=reparameterize(circle_cnr),
    Parameters=series_2,
    Radii=[Slider(2.033, range=0.1..10), Slider(3.527, range=0.1..10), Slider(2.033, range=0.1..10), Slider(1.332, range=0.1..10), Slider(0.891, range=0.1..10), Slider(0.781, range=0.1..10), Slider(0.781, range=0.1..10), Slider(0.781, range=0.1..10), Slider(0.891, range=0.1..10), Slider(1.332, range=0.1..10)],
    Caps=0)
number_slider = Slider(720, range=0..1000)
number_slider_2 = Slider(0.2, range=0..1)
number_slider_3 = Slider(750, range=0..1000)
negative = Negative(Value=evaluate_curve.Tangent)
curve_emitter = CurveEmitter(Curve=circle_cnr_2, ContinuousFlow=True, CreationRate=1, NumberOfAgents=Slider(46, range=0..100))
brep_environment = BrepEnvironment(Brep=pipe_variable)
construct_agent = ConstructAgent(
    Lifespan=number_slider,
    Mass=1,
    BodySize=1,
    MaxSpeed=number_slider_2,
    MaxForce=0.1,
    VisionAngle=15,
    VisionRadius=5,
    HistoryLength=number_slider_3,
    InitialVelocity=evaluate_curve.Tangent)
construct_agent_2 = ConstructAgent(
    Lifespan=number_slider,
    Mass=1,
    BodySize=1,
    MaxSpeed=number_slider_2,
    MaxForce=0.1,
    VisionAngle=15,
    VisionRadius=5,
    HistoryLength=number_slider_3,
    InitialVelocity=negative)
boolean_toggle = BooleanToggle(False)
system = System(Agents=construct_agent_2, Emitters=curve_emitter)
system_2 = System(Agents=construct_agent, Emitters=curve_emitter)
timer = Timer(TimerInterval=1, Target=[system_2, deconstruct_system_2, system, deconstruct_system])  # disabled

# ---- group: interactions within
vis_rad = Slider(1.5, range=0..10)
align = Slider(1.3, range=0..10)
cohese = Slider(2.5, range=0..10)

# ----
vis_rad_2 = Slider(1.6, range=0..10)
separate = Slider(0.3, range=0..10)

# ---- group: Boundary
strength = Slider(0.3, range=0..1)
buffer = Slider(0.6, range=0..1)

# ----
deconstruct_system = DeconstructSystem(System=system)  # -> Agents, AgentCollection
deconstruct_system_2 = DeconstructSystem(System=system_2)  # -> Agents, AgentCollection
engine = Engine(Reset=boolean_toggle, System=system)
engine_2 = Engine(Reset=boolean_toggle, System=system_2)

# ---- group: Systems with Each other
vis_rad_3 = Slider(1.6, range=0..10)
separation = Slider(0.3, range=0..10)

# ----
contain_force = ContainForce(Agent=deconstruct_system.Agents, Environment=brep_environment, WeightMultiplier=strength, VisionRadius=buffer)
get_neighbors_in_radius = GetNeighborsInRadius(
    Agent=deconstruct_system.Agents,
    AgentCollection=deconstruct_system.AgentCollection,
    VisionRadius=vis_rad,
    VisionAngle=15)
get_neighbors_in_radius_2 = GetNeighborsInRadius(
    Agent=deconstruct_system.Agents,
    AgentCollection=deconstruct_system.AgentCollection,
    VisionRadius=vis_rad_2,
    VisionAngle=15)
contain_force_2 = ContainForce(Agent=deconstruct_system_2.Agents, Environment=brep_environment, WeightMultiplier=strength, VisionRadius=buffer)
get_neighbors_in_radius_3 = GetNeighborsInRadius(
    Agent=deconstruct_system_2.Agents,
    AgentCollection=deconstruct_system_2.AgentCollection,
    VisionRadius=vis_rad,
    VisionAngle=15)
get_neighbors_in_radius_4 = GetNeighborsInRadius(
    Agent=deconstruct_system_2.Agents,
    AgentCollection=deconstruct_system_2.AgentCollection,
    VisionRadius=vis_rad_2,
    VisionAngle=15)
get_neighbors_in_radius_5 = GetNeighborsInRadius(
    Agent=deconstruct_system.Agents,
    AgentCollection=deconstruct_system_2.AgentCollection,
    VisionRadius=vis_rad_3,
    VisionAngle=15)
get_neighbors_in_radius_6 = GetNeighborsInRadius(
    Agent=deconstruct_system_2.Agents,
    AgentCollection=deconstruct_system.AgentCollection,
    VisionRadius=vis_rad_3,
    VisionAngle=15)
deconstruct_agent = DeconstructAgent(Agent=deconstruct_system_2.Agents)  # -> Position, Velocity, Acceleration, Lifespan, PositionHistory
deconstruct_agent_2 = DeconstructAgent(Agent=deconstruct_system.Agents)  # -> Position, Velocity, Acceleration, Lifespan, PositionHistory
separate_force = SeparateForce(Agent=deconstruct_system.Agents, GetNeighborsInRadius=get_neighbors_in_radius_6, WeightMultiplier=separation)
separate_force_2 = SeparateForce(Agent=deconstruct_system_2.Agents, GetNeighborsInRadius=get_neighbors_in_radius_5, WeightMultiplier=separation)
cull_pattern = CullPattern(List=deconstruct_agent_2.PositionHistory, CullPattern=[False, False, False, True])
cull_pattern_2 = CullPattern(List=deconstruct_agent.PositionHistory, CullPattern=[False, False, False, True])
align_force = AlignForce(Agent=deconstruct_system_2.Agents, GetNeighborsInRadius=get_neighbors_in_radius_3, WeightMultiplier=align)
cohese_force = CoheseForce(Agent=deconstruct_system_2.Agents, GetNeighborsInRadius=get_neighbors_in_radius_3, WeightMultiplier=separate)
separate_force_3 = SeparateForce(Agent=deconstruct_system_2.Agents, GetNeighborsInRadius=get_neighbors_in_radius_4, WeightMultiplier=cohese)
align_force_2 = AlignForce(Agent=deconstruct_system.Agents, GetNeighborsInRadius=get_neighbors_in_radius, WeightMultiplier=align)
cohese_force_2 = CoheseForce(Agent=deconstruct_system.Agents, GetNeighborsInRadius=get_neighbors_in_radius, WeightMultiplier=separate)
separate_force_4 = SeparateForce(Agent=deconstruct_system.Agents, GetNeighborsInRadius=get_neighbors_in_radius_2, WeightMultiplier=cohese)
interpolate = Interpolate(Vertices=cull_pattern, Degree=3, Periodic=False, KnotStyle=1)  # -> Curve, Length, Domain
interpolate_2 = Interpolate(Vertices=cull_pattern_2, Degree=3, Periodic=False, KnotStyle=1)  # -> Curve, Length, Domain

# ---- group: Systems to point[s]
number_slider_4 = Slider(0.2, range=0..10)
number_slider_5 = Slider(0.2, range=0..10)

# ----
point = Point(<point referenced from the Rhino model>)

# ---- group: Systems to point[s]
number_slider_6 = Slider(1.2, range=0..10)
number_slider_7 = Slider(1.5, range=0..10)

# ----
attract_force = AttractForce(
    Agent=[deconstruct_system_2.Agents, deconstruct_system.Agents],
    Point=point,
    WeightMultiplier=number_slider_5,
    AttractionRadius=number_slider_4)  # disabled
curve = Curve(<curve referenced from the Rhino model>)
curve_2 = Curve(<curve referenced from the Rhino model>)
geometry = Geometry([interpolate.Curve, interpolate_2.Curve])
follow_path_force = FollowPathForce(
    Agent=deconstruct_system_2.Agents,
    WeightMultiplier=1,
    Curve=curve_2,
    PathRadius=5,
    PredictionDistance=5,
    PathTargetDistance=5)  # disabled
follow_path_force_2 = FollowPathForce(
    Agent=deconstruct_system.Agents,
    WeightMultiplier=1,
    Curve=curve,
    PathRadius=5,
    PredictionDistance=5,
    PathTargetDistance=5)  # disabled
end_points = EndPoints(Curve=interpolate.Curve)  # -> Start, End
end_points_2 = EndPoints(Curve=interpolate_2.Curve)  # -> Start, End
point_in_brep = PointInBrep(Brep=pipe_variable, Point=end_points_2.End, Strict=False)
point_in_brep_2 = PointInBrep(Brep=pipe_variable, Point=end_points.End, Strict=False)
cull_pattern_3 = CullPattern(List=interpolate_2.Curve, CullPattern=point_in_brep)
cull_pattern_4 = CullPattern(List=interpolate.Curve, CullPattern=point_in_brep_2)
geometry_2 = Geometry([cull_pattern_4, cull_pattern_3])
pipe = Pipe(Curve=geometry_2, Radius=Slider(0.1, range=0..0.1), Caps=0)
